# Grasshopper definition segmentation.gh (Grasshopper 0.9.76)
# Copyright: © 2017 Pierre Cuvilliers, Caitlin Mueller, Massachusetts Institute of Technology
# plug-ins: Python Interpreter

panel = Panel("""numpy

scipy
sklearn
sklearn.preprocessing
sklearn.cross_validation
sklearn.linear_model
sklearn.metrics""")
pythonremote = GHPythonRemote(location="c:\Python27", run=Toggle(False), modules=panel)  # -> out, linked_modules, import_statements

testset = TestSet()  # -> brep_5, brep_6, R, brep_7, brep_8
trainingset = TrainingSet()  # -> L_3, L_2, L_4, L
archelements = Merge(Data1=trainingset.L_3, Data2=trainingset.L_2, Data3=trainingset.L_4, Data4=trainingset.L)  # -> flatten(Result)
merge = Merge(Data1=testset.brep_5, Data2=testset.brep_6, Data3=testset.brep_7, Data4=testset.brep_8)
lng = ListLength(List=merge)
partition = PartitionList(List=archelements, Size=4)
partition_2 = PartitionList(List=testset.R, Size=lng)
flip = FlipMatrix(Data=partition_2)
data = Data(simplify(partition))
data_2 = Data(simplify(flip))
logisticregression = PythonScript(training_set=data, test_set=data_2)  # -> out, data_list, test_list, yp, yt; inputs training_set: tree, test_set: tree
# ---------- logisticregression: Python ----------
__author__="GizemYetis, OzanYetkin, KongpyungMoon & Ozkan Kilic"
__mail__="yetis.gizem@metu.edu.tr, ozan.yetkin@metu.edu.tr, kpmoon@gmail.com & okilic@ybu.edu.tr"
__institution__="Middle East Technical University, Yildirim Beyazit University"

from Grasshopper import DataTree
import scriptcontext
np = scriptcontext.sticky['numpy']
sk = scriptcontext.sticky['sklearn']

data_list=[list(i) for i in training_set.Branches]
x_train=[]
y_train=[]
for d in range(data_list.Count): 
    x_train.append(data_list[d][:len(training_set.Branches[d])-1])
    y_train.append(data_list[d][len(training_set.Branches[d])-1:])

test_list=[list(i) for i in test_set.Branches]
x_test=[]
y_test=[]
for d in range(test_list.Count): 
    x_test.append(test_list[d][:len(test_set.Branches[d])-1])
    y_test.append(test_list[d][len(test_set.Branches[d])-1:])
for row in x_test:
    for k in (0,1,2):
        row[k] = float(row[k])

skpp = scriptcontext.sticky['sklearn.preprocessing']
labelencoder_y = skpp.LabelEncoder()
y_train = labelencoder_y.fit_transform(y_train)
y_test = labelencoder_y.fit_transform(y_test)

"""skcv=scriptcontext.sticky['sklearn.cross_validation']
x_train, x_test, y_train, y_test = skcv.train_test_split(x, y, test_size = 0.20, random_state = 0)"""

sklm=scriptcontext.sticky['sklearn.linear_model']
classifier = sklm.LogisticRegression(random_state=None)
classifier.fit(x_train, y_train)
y_pred = classifier.predict(x_test)

skm=scriptcontext.sticky['sklearn.metrics']
cm = skm.confusion_matrix(y_test, y_pred)

yp=np.ndarray.tolist(labelencoder_y.inverse_transform(y_pred))
yt=np.ndarray.tolist(labelencoder_y.inverse_transform(y_test))

print(yp)
print(yt)
# ---------- end logisticregression ----------
knearestneighbours = PythonScript(training_set=data, test_set=data_2)  # -> out, data_list, test_list, yp, yt; inputs training_set: tree, test_set: tree
# ---------- knearestneighbours: Python ----------
__author__="GizemYetis, OzanYetkin, KongpyungMoon & Ozkan Kilic"
__mail__="yetis.gizem@metu.edu.tr, ozan.yetkin@metu.edu.tr, kpmoon@gmail.com & okilic@ybu.edu.tr"
__institution__="Middle East Technical University, Yildirim Beyazit University"

from Grasshopper import DataTree
import scriptcontext
np = scriptcontext.sticky['numpy']
sk = scriptcontext.sticky['sklearn']

data_list=[list(i) for i in training_set.Branches]
x_train=[]
y_train=[]
for d in range(data_list.Count): 
    x_train.append(data_list[d][:len(training_set.Branches[d])-1])
    y_train.append(data_list[d][len(training_set.Branches[d])-1:])

test_list=[list(i) for i in test_set.Branches]
x_test=[]
y_test=[]
for d in range(test_list.Count): 
    x_test.append(test_list[d][:len(test_set.Branches[d])-1])
    y_test.append(test_list[d][len(test_set.Branches[d])-1:])
for row in x_test:
    for k in (0,1,2):
        row[k] = float(row[k])

skpp = scriptcontext.sticky['sklearn.preprocessing']
labelencoder_y = skpp.LabelEncoder()
y_train = labelencoder_y.fit_transform(y_train)
y_test = labelencoder_y.fit_transform(y_test)

"""skcv=scriptcontext.sticky['sklearn.cross_validation']
x_train, x_test, y_train, y_test = skcv.train_test_split(x, y, test_size = 0.20, random_state = 0)"""

sklm=scriptcontext.sticky['sklearn.neighbors']
classifier = sklm.KNeighborsClassifier(n_neighbors = 5, metric = 'minkowski', p = 2)
classifier.fit(x_train, y_train)
y_pred = classifier.predict(x_test)

skm=scriptcontext.sticky['sklearn.metrics']
cm = skm.confusion_matrix(y_test, y_pred)

yp=np.ndarray.tolist(labelencoder_y.inverse_transform(y_pred))
yt=np.ndarray.tolist(labelencoder_y.inverse_transform(y_test))

print(yp)
print(yt)
# ---------- end knearestneighbours ----------
linearsvm = PythonScript(training_set=data, test_set=data_2)  # -> out, data_list, test_list, yp, yt; inputs training_set: tree, test_set: tree
# ---------- linearsvm: Python ----------
__author__="GizemYetis, OzanYetkin, KongpyungMoon & Ozkan Kilic"
__mail__="yetis.gizem@metu.edu.tr, ozan.yetkin@metu.edu.tr, kpmoon@gmail.com & okilic@ybu.edu.tr"
__institution__="Middle East Technical University, Yildirim Beyazit University"

from Grasshopper import DataTree
import scriptcontext
np = scriptcontext.sticky['numpy']
sk = scriptcontext.sticky['sklearn']

data_list=[list(i) for i in training_set.Branches]
x_train=[]
y_train=[]
for d in range(data_list.Count): 
    x_train.append(data_list[d][:len(training_set.Branches[d])-1])
    y_train.append(data_list[d][len(training_set.Branches[d])-1:])

test_list=[list(i) for i in test_set.Branches]
x_test=[]
y_test=[]
for d in range(test_list.Count): 
    x_test.append(test_list[d][:len(test_set.Branches[d])-1])
    y_test.append(test_list[d][len(test_set.Branches[d])-1:])
for row in x_test:
    for k in (0,1,2):
        row[k] = float(row[k])

skpp = scriptcontext.sticky['sklearn.preprocessing']
labelencoder_y = skpp.LabelEncoder()
y_train = labelencoder_y.fit_transform(y_train)
y_test = labelencoder_y.fit_transform(y_test)

"""skcv=scriptcontext.sticky['sklearn.cross_validation']
x_train, x_test, y_train, y_test = skcv.train_test_split(x, y, test_size = 0.20, random_state = 0)"""

sklm=scriptcontext.sticky['sklearn.svm']
classifier = sklm.SVC(kernel = 'linear', random_state = None)
classifier.fit(x_train, y_train)
y_pred = classifier.predict(x_test)

skm=scriptcontext.sticky['sklearn.metrics']
cm = skm.confusion_matrix(y_test, y_pred)

yp=np.ndarray.tolist(labelencoder_y.inverse_transform(y_pred))
yt=np.ndarray.tolist(labelencoder_y.inverse_transform(y_test))

print(yp)
print(yt)
# ---------- end linearsvm ----------
kernelsvm = PythonScript(training_set=data, test_set=data_2)  # -> out, data_list, test_list, yp, yt; inputs training_set: tree, test_set: tree
# ---------- kernelsvm: Python ----------
__author__="GizemYetis, OzanYetkin, KongpyungMoon & Ozkan Kilic"
__mail__="yetis.gizem@metu.edu.tr, ozan.yetkin@metu.edu.tr, kpmoon@gmail.com & okilic@ybu.edu.tr"
__institution__="Middle East Technical University, Yildirim Beyazit University"

from Grasshopper import DataTree
import scriptcontext
np = scriptcontext.sticky['numpy']
sk = scriptcontext.sticky['sklearn']

data_list=[list(i) for i in training_set.Branches]
x_train=[]
y_train=[]
for d in range(data_list.Count): 
    x_train.append(data_list[d][:len(training_set.Branches[d])-1])
    y_train.append(data_list[d][len(training_set.Branches[d])-1:])

test_list=[list(i) for i in test_set.Branches]
x_test=[]
y_test=[]
for d in range(test_list.Count): 
    x_test.append(test_list[d][:len(test_set.Branches[d])-1])
    y_test.append(test_list[d][len(test_set.Branches[d])-1:])
for row in x_test:
    for k in (0,1,2):
        row[k] = float(row[k])

skpp = scriptcontext.sticky['sklearn.preprocessing']
labelencoder_y = skpp.LabelEncoder()
y_train = labelencoder_y.fit_transform(y_train)
y_test = labelencoder_y.fit_transform(y_test)

sc = skpp.StandardScaler()
x_train = sc.fit_transform(x_train)
x_test = sc.transform(x_test)

sklm=scriptcontext.sticky['sklearn.svm']
classifier = sklm.SVC(kernel = 'rbf', random_state = None)
classifier.fit(x_train, y_train)
y_pred = classifier.predict(x_test)

skm=scriptcontext.sticky['sklearn.metrics']
cm = skm.confusion_matrix(y_test, y_pred)

yp=np.ndarray.tolist(labelencoder_y.inverse_transform(y_pred))
yt=np.ndarray.tolist(labelencoder_y.inverse_transform(y_test))

print(yp)
print(yt)
# ---------- end kernelsvm ----------
naivebayes = PythonScript(training_set=data, test_set=data_2)  # -> out, data_list, test_list, yp, yt; inputs training_set: tree, test_set: tree
# ---------- naivebayes: Python ----------
__author__="GizemYetis, OzanYetkin, KongpyungMoon & Ozkan Kilic"
__mail__="yetis.gizem@metu.edu.tr, ozan.yetkin@metu.edu.tr, kpmoon@gmail.com & okilic@ybu.edu.tr"
__institution__="Middle East Technical University, Yildirim Beyazit University"

from Grasshopper import DataTree
import scriptcontext
np = scriptcontext.sticky['numpy']
sk = scriptcontext.sticky['sklearn']

data_list=[list(i) for i in training_set.Branches]
x_train=[]
y_train=[]
for d in range(data_list.Count): 
    x_train.append(data_list[d][:len(training_set.Branches[d])-1])
    y_train.append(data_list[d][len(training_set.Branches[d])-1:])

test_list=[list(i) for i in test_set.Branches]
x_test=[]
y_test=[]
for d in range(test_list.Count): 
    x_test.append(test_list[d][:len(test_set.Branches[d])-1])
    y_test.append(test_list[d][len(test_set.Branches[d])-1:])
for row in x_test:
    for k in (0,1,2):
        row[k] = float(row[k])

skpp = scriptcontext.sticky['sklearn.preprocessing']
labelencoder_y = skpp.LabelEncoder()
y_train = labelencoder_y.fit_transform(y_train)
y_test = labelencoder_y.fit_transform(y_test)

"""sc = skpp.StandardScaler()
x_train = sc.fit_transform(x_train)
x_test = sc.transform(x_test)"""

sklm=scriptcontext.sticky['sklearn.naive_bayes']
classifier = sklm.GaussianNB()
classifier.fit(x_train, y_train)
y_pred = classifier.predict(x_test)

skm=scriptcontext.sticky['sklearn.metrics']
cm = skm.confusion_matrix(y_test, y_pred)

yp=np.ndarray.tolist(labelencoder_y.inverse_transform(y_pred))
yt=np.ndarray.tolist(labelencoder_y.inverse_transform(y_test))

print(yp)
print(yt)
# ---------- end naivebayes ----------
decisiontree = PythonScript(training_set=data, test_set=data_2)  # -> out, data_list, test_list, yp, yt; inputs training_set: tree, test_set: tree
# ---------- decisiontree: Python ----------
__author__="GizemYetis, OzanYetkin, KongpyungMoon & Ozkan Kilic"
__mail__="yetis.gizem@metu.edu.tr, ozan.yetkin@metu.edu.tr, kpmoon@gmail.com & okilic@ybu.edu.tr"
__institution__="Middle East Technical University, Yildirim Beyazit University"

from Grasshopper import DataTree
import scriptcontext
np = scriptcontext.sticky['numpy']
sk = scriptcontext.sticky['sklearn']

data_list=[list(i) for i in training_set.Branches]
x_train=[]
y_train=[]
for d in range(data_list.Count): 
    x_train.append(data_list[d][:len(training_set.Branches[d])-1])
    y_train.append(data_list[d][len(training_set.Branches[d])-1:])

test_list=[list(i) for i in test_set.Branches]
x_test=[]
y_test=[]
for d in range(test_list.Count): 
    x_test.append(test_list[d][:len(test_set.Branches[d])-1])
    y_test.append(test_list[d][len(test_set.Branches[d])-1:])
for row in x_test:
    for k in (0,1,2):
        row[k] = float(row[k])

skpp = scriptcontext.sticky['sklearn.preprocessing']
labelencoder_y = skpp.LabelEncoder()
y_train = labelencoder_y.fit_transform(y_train)
y_test = labelencoder_y.fit_transform(y_test)

"""sc = skpp.StandardScaler()
x_train = sc.fit_transform(x_train)
x_test = sc.transform(x_test)"""

sklm=scriptcontext.sticky['sklearn.tree']
classifier = sklm.DecisionTreeClassifier(criterion = 'entropy', random_state = None)
classifier.fit(x_train, y_train)
y_pred = classifier.predict(x_test)

skm=scriptcontext.sticky['sklearn.metrics']
cm = skm.confusion_matrix(y_test, y_pred)

yp=np.ndarray.tolist(labelencoder_y.inverse_transform(y_pred))
yt=np.ndarray.tolist(labelencoder_y.inverse_transform(y_test))

print(yp)
print(yt)
# ---------- end decisiontree ----------
randomforest = PythonScript(training_set=data, test_set=data_2)  # -> out, data_list, test_list, yp, yt; inputs training_set: tree, test_set: tree
# ---------- randomforest: Python ----------
__author__="GizemYetis, OzanYetkin, KongpyungMoon & Ozkan Kilic"
__mail__="yetis.gizem@metu.edu.tr, ozan.yetkin@metu.edu.tr, kpmoon@gmail.com & okilic@ybu.edu.tr"
__institution__="Middle East Technical University, Yildirim Beyazit University"

from Grasshopper import DataTree
import scriptcontext
np = scriptcontext.sticky['numpy']
sk = scriptcontext.sticky['sklearn']

data_list=[list(i) for i in training_set.Branches]
x_train=[]
y_train=[]
for d in range(data_list.Count): 
    x_train.append(data_list[d][:len(training_set.Branches[d])-1])
    y_train.append(data_list[d][len(training_set.Branches[d])-1:])

test_list=[list(i) for i in test_set.Branches]
x_test=[]
y_test=[]
for d in range(test_list.Count): 
    x_test.append(test_list[d][:len(test_set.Branches[d])-1])
    y_test.append(test_list[d][len(test_set.Branches[d])-1:])
for row in x_test:
    for k in (0,1,2):
        row[k] = float(row[k])

skpp = scriptcontext.sticky['sklearn.preprocessing']
labelencoder_y = skpp.LabelEncoder()
y_train = labelencoder_y.fit_transform(y_train)
y_test = labelencoder_y.fit_transform(y_test)

"""skcv=scriptcontext.sticky['sklearn.cross_validation']
x_train, x_test, y_train, y_test = skcv.train_test_split(x, y, test_size = 0.20, random_state = 0)"""

sklm=scriptcontext.sticky['sklearn.ensemble']
classifier = sklm.RandomForestClassifier(criterion = 'entropy', random_state = None)
classifier.fit(x_train, y_train)
y_pred = classifier.predict(x_test)

skm=scriptcontext.sticky['sklearn.metrics']
cm = skm.confusion_matrix(y_test, y_pred)

yp=np.ndarray.tolist(labelencoder_y.inverse_transform(y_pred))
yt=np.ndarray.tolist(labelencoder_y.inverse_transform(y_test))

print(yp)
print(yt)
# ---------- end randomforest ----------
listtotree = ListToTree(PythonList=logisticregression.yt)  # -> DataTree; inputs PythonList: list, BasePath: list of Int32
# ---------- listtotree: Python ----------
from Grasshopper import DataTree as Tree
from Grasshopper.Kernel.Data import GH_Path as Path
from System import Array

def list_to_tree(input, none_and_holes=False, base_path=[0]):
    """Transforms nestings of lists or tuples to a Grasshopper DataTree"""
    
    def process_one_item(input,tree,track):
        path = Path(Array[int](track))
        if len(input) == 0 and none_and_holes: tree.EnsurePath(path); return
        for i,item in enumerate(input):
            if hasattr(item, '__iter__'): #if list or tuple
                track.append(i); process_one_item(item,tree,track); track.pop()
            else:
                if none_and_holes: tree.Insert(item,path,i)
                elif item is not None: tree.Add(item,path)
    tree = Tree[object]()
    if input is not None: process_one_item(input,tree,base_path[:]); return tree
    

pythonList = PythonList or []
None_and_holes = False
Base_path = BasePath or [0]


DataTree = list_to_tree(pythonList,none_and_holes = None_and_holes, base_path= Base_path)
# ---------- end listtotree ----------
panel_2 = Panel(listtotree)
coloring = PythonScript(category=listtotree)  # -> color; inputs category: tree
# ---------- coloring: Python ----------
__author__="GizemYetis, OzanYetkin, KongpyungMoon & Ozkan Kilic"
__mail__="yetis.gizem@metu.edu.tr, ozan.yetkin@metu.edu.tr, kpmoon@gmail.com & okilic@ybu.edu.tr"
__institution__="Middle East Technical University, Yildirim Beyazit University"

from Grasshopper import DataTree
c = [list(i) for i in category.Branches]
color = []
for j in c[0]:
    if j == "column":
        color.append("red")
    elif j == "beam":
        color.append("blue")
    elif j == "wall":
        color.append("green")
    elif j == "slab":
        color.append("yellow")
print(color)
# ---------- end coloring ----------

layering = PythonScript(elements=merge, layer=listtotree, color=coloring, active=Toggle(False))  # -> segmented_model; inputs elements: list, layer: list, color: list
# ---------- layering: Python ----------
__author__="GizemYetis, OzanYetkin, KongpyungMoon & Ozkan Kilic"
__mail__="yetis.gizem@metu.edu.tr, ozan.yetkin@metu.edu.tr, kpmoon@gmail.com & okilic@ybu.edu.tr"
__institution__="Middle East Technical University, Yildirim Beyazit University"

import rhinoscriptsyntax as rs
import Rhino
import scriptcontext as sc
import System.Drawing.Color as sdc

if active:
    #create layer
    sc.doc = Rhino.RhinoDoc.ActiveDoc
    for i,j in zip(layer,color):
        rs.AddLayer(name=i, color=sdc.FromName(j), visible=True)
    
    #create object
    sc.doc = ghdoc
    attributes=[]
    geometry=[]
    for i in elements:
        doc_obj=rs.coercerhinoobject(i)
        attributes.append(doc_obj.Attributes)
        geometry.append(doc_obj.Geometry)
    
    #match layers
    sc.doc = Rhino.RhinoDoc.ActiveDoc
    layertable = sc.doc.Layers
    for l,a,g in zip(layer, attributes, geometry):
        layerindex = layertable.Find(l,True)
        a.LayerIndex = layerindex
        #bake objects
        rhino_obj = sc.doc.Objects.Add(g,a)
    sc.doc = ghdoc
# ---------- end layering ----------

# ==== cluster GHPythonRemote: Connects the Grasshopper Python component to an external Python instance.
python = PythonScript()  # -> gh_parent_doc_dir
# ---------- python: Python ----------
from os import path

gh_parent_doc_dir = path.abspath(path.dirname(ghenv.Component.OnPingDocument().Owner.OnPingDocument().FilePath))
# ---------- end python ----------
# GH to python remote example.
# Pierre Cuvilliers, 2017
# Released under the MIT license
# github.com/pilcru/ghpythonremote
# Runs and connects to an external python engine, and
# assigns imported modules to scriptcontext.sticky variables.
# 
# Arguments:
#       code (str): Path to the GH_to_python_sticky.py code file.
#       location (str): Path to a python executable, or to a folder
#             containing `python.exe`, or the name of a conda-created
#             virtual environment prefixed by `conda://` (`conda://env_name`).
#             If empty, finds python from your windows %PATH%.
#       run (boolean): Creates the connection, and imports new
#             modules, when turned to True. Kills the connection,
#             and deletes the references to the imports, when turned
#             to False.
#       modules (str list): List of module names to import in the
#             remote python. They will be added to the
#             scriptcontext.sticky dictionary, allowing them to be
#             reused from other python components in the same
#             Grasshopper document. Submodules (for example
#             `numpy.linalg` have to be added explicitly to this list
#             to be available later.
#       log_level (str from ['NOTSET', 'DEBUG', 'INFO', 'WARNING', 'ERROR', 'CRITICAL']):
#             Logging level to use for the local IronPython and the
#             remote python instance.
#       working_dir (str): Working directory for the remote python
#             instance.
# 
# Returns:
#       out (str): Console output with DEBUG information.
#       linked_modules (str list): list of imported module names.
location = ClusterInput()  # location (str): Path to a python executable, or to a folder containing `python.exe`, or the name of a conda-created virtual environment prefixed by `conda://` (`conda://env_name`). If empty, finds python from your windows %PATH%.
run = ClusterInput()  # run (boolean): Creates the connection, and imports new modules, when turned to True. Kills the connection,and deletes the references to the imports, when turned to False.
modules = ClusterInput()  # modules (str list): List of module names to import in the remote python. They will be added to the scriptcontext.sticky dictionary, allowing them to be reused from other python components in the same Grasshopper document. Submodules (for example `numpy.linalg` have to be added explicitly to this list to be available later.
list = ValueList({"CRITICAL", "ERROR", "WARNING", "INFO", "DEBUG", "NOTSET"}, selected="DEBUG")
panel = Panel(python)
python_2 = PythonScript(location=location, run=run, modules=modules, log_level=list, working_dir=panel)  # -> out, linked_modules; inputs run: Boolean, modules: list
# ---------- python_2: Python ----------
import sys
import scriptcontext
import logging
import inspect
import ghpythonremote
from ghpythonremote.connectors import GrasshopperToPythonRemote
from os import path
from time import sleep

local_log_level = getattr(logging, log_level, logging.WARNING)
logger = logging.getLogger('ghpythonremote')
logger.setLevel(local_log_level)
ch = logging.StreamHandler()
ch.setLevel(local_log_level)
formatter = logging.Formatter('%(levelname)s: %(name)s:\n%(message)s')
ch.setFormatter(formatter)
logger.handlers = []
logger.addHandler(ch)
logger = logging.getLogger('ghpythonremote.GH_to_python_sticky')

ROOT = path.abspath(path.dirname(inspect.getfile(ghpythonremote)))
rpyc_server_py = path.join(ROOT, 'pythonservice.py')

# Set connection to CLOSED if this is the first run
# and initialize set of linked modules
try:
    remote_python_status
except NameError:
    remote_python_status = 'CLOSED'
    lkd_modules = set()

# Wait for connection to connect or terminate
timer = 0
while remote_python_status == 'CONNECTING' or remote_python_status == 'CLOSING':
    sleep(1)
    timer += 1
    if timer == 10:
        try:
            gh2py_manager.__exit__(*sys.exc_info())
        except Exception:
            pass
        remote_python_status = 'CLOSED'
        lkd_modules = set()
        raise RuntimeError("Connection left in an inconsistent state and not returning. Reset everything.")

if run:
    if not remote_python_status == 'OPEN':
        remote_python_status = 'CONNECTING'
        gh2py_manager = GrasshopperToPythonRemote(rpyc_server_py, location=location, timeout=10,
                                                  port=None, log_level=log_level, working_dir=working_dir)
        gh2py = gh2py_manager.__enter__()
        remote_python_status = 'OPEN'

    # Stuff that we can reach
    rpymod = gh2py.py_remote_modules  # A getter function for a named python module
    rpy = gh2py.connection  # Represents the remote instance root object
    # Add modules
    for mod in modules:
        try:
            scriptcontext.sticky[mod] = rpymod(mod)
            lkd_modules.add(mod)
        except ImportError:
            gh2py_manager.__exit__(*sys.exc_info())
            raise

elif not remote_python_status == 'CLOSED':
    remote_python_status = 'CLOSING'
    # Remove linked modules
    for mod in lkd_modules:
        del scriptcontext.sticky[mod]
    gh2py_manager.__exit__(*sys.exc_info())
    lkd_modules = set()
    remote_python_status = 'CLOSED'

# Change variable name because ghpython resets outputs to None before each run
linked_modules = lkd_modules

logger.info('GH to python connection is {}'.format(remote_python_status))
# ---------- end python_2 ----------
python_3 = PythonScript(module_names=python_2.linked_modules)  # -> import_statements; inputs module_names: list
# ---------- python_3: Python ----------
import_statements = ["import scriptcontext as sc"]
for module_name in module_names:
    import_statements.append("{0} = sc.sticky['{0}']".format(module_name))

if len(module_names) == 0:
    import_statements = []
# ---------- end python_3 ----------
out = ClusterOutput(python_2.out)  # Console output.
linked_modules = ClusterOutput(python_2.linked_modules)  # Names of modules that were successfully added to the scriptcontext.sticky dictionary.
import_statements = ClusterOutput(python_3)  # Useful import statements to use the imported modules in your scripts.

# ==== cluster TrainingSet

dom = ConstructDomain(DomainStart=Slider(40, range=0..100), DomainEnd=Slider(80, range=0..1000))
dom_2 = ConstructDomain(DomainStart=Slider(250, range=0..1000), DomainEnd=Slider(1000, range=0..1000))
dom_3 = ConstructDomain(DomainStart=Slider(20, range=0..100), DomainEnd=Slider(50, range=0..100))
random = Random(Range=dom_3, Number=Slider(100, range=0..100), Seed=Slider(5, range=0..10))
random_2 = Random(Range=dom_2, Number=Slider(100, range=0..100), Seed=2)
random_3 = Random(Range=dom, Number=Slider(100, range=0..100), Seed=2)
box = CenterBox(Base=PlaneXY(0, 0, 0), X=random, Y=random_2, Z=random_3)

dom_4 = ConstructDomain(DomainStart=Slider(40, range=0..100), DomainEnd=Slider(80, range=0..1000))
dom_5 = ConstructDomain(DomainStart=Slider(250, range=0..1000), DomainEnd=Slider(1000, range=0..1000))
dom_6 = ConstructDomain(DomainStart=Slider(20, range=0..100), DomainEnd=Slider(50, range=0..100))
random_4 = Random(Range=dom_6, Number=Slider(100, range=0..100), Seed=Slider(5, range=0..10))
random_5 = Random(Range=dom_5, Number=Slider(100, range=0..100), Seed=2)
random_6 = Random(Range=dom_4, Number=Slider(100, range=0..100), Seed=2)
box_2 = CenterBox(Base=PlaneXY(0, 0, 0), X=random_5, Y=random_4, Z=random_6)

dom_7 = ConstructDomain(DomainStart=Slider(500, range=0..1000), DomainEnd=Slider(1000, range=0..1000))
dom_8 = ConstructDomain(DomainStart=Slider(10, range=0..100), DomainEnd=Slider(30, range=0..100))
dom_9 = ConstructDomain(DomainStart=Slider(250, range=0..1000), DomainEnd=Slider(600, range=0..1000))
random_7 = Random(Range=dom_8, Number=Slider(100, range=0..100), Seed=5)
random_8 = Random(Range=dom_7, Number=Slider(100, range=0..100), Seed=1)
random_9 = Random(Range=dom_9, Number=Slider(100, range=0..100), Seed=2)
wall = CenterBox(Base=PlaneXY(0, 0, 0), X=random_7, Y=random_8, Z=random_9)

dom_10 = ConstructDomain(DomainStart=Slider(10, range=0..100), DomainEnd=Slider(30, range=0..100))
random_10 = Random(Range=dom_10, Number=Slider(100, range=0..100), Seed=2)
dom_11 = ConstructDomain(DomainStart=Slider(250, range=0..1000), DomainEnd=Slider(1000, range=0..1000))
random_11 = Random(Range=dom_11, Number=Slider(100, range=0..100), Seed=5)
jitter = Jitter(List=random_11, Jitter=Slider(1, range=0..1), Seed=2)  # -> Values, Indices

dom_12 = ConstructDomain(DomainStart=Slider(20, range=0..100), DomainEnd=Slider(50, range=0..100))
random_12 = Random(Range=dom_12, Number=Slider(100, range=0..100), Seed=2)
dom_13 = ConstructDomain(DomainStart=Slider(250, range=0..1000), DomainEnd=Slider(1000, range=0..1000))
jitter_2 = Jitter(List=random_12, Jitter=Slider(1, range=0..1), Seed=2)  # -> Values, Indices
random_13 = Random(Range=dom_13, Number=Slider(100, range=0..100), Seed=2)

dom_14 = ConstructDomain(DomainStart=Slider(500, range=0..1000), DomainEnd=Slider(1000, range=0..1000))
dom_15 = ConstructDomain(DomainStart=Slider(10, range=0..100), DomainEnd=Slider(30, range=0..100))
dom_16 = ConstructDomain(DomainStart=Slider(250, range=0..1000), DomainEnd=Slider(700, range=0..1000))
random_14 = Random(Range=dom_15, Number=Slider(100, range=0..100), Seed=5)
random_15 = Random(Range=dom_14, Number=Slider(100, range=0..100), Seed=1)
random_16 = Random(Range=dom_16, Number=Slider(100, range=0..100), Seed=2)
wall_2 = CenterBox(Base=PlaneXY(0, 0, 0), X=random_15, Y=random_14, Z=random_16)

slab = CenterBox(Base=PlaneXY(0, 0, 0), X=random_11, Y=jitter.Values, Z=random_10)  # -> flatten(Box)
beam = Merge(Data1=box, Data2=box_2)  # -> flatten(Result)
column = CenterBox(Base=PlaneXY(0, 0, 0), X=random_12, Y=jitter_2.Values, Z=random_13)  # -> flatten(Box)
wall_3 = Merge(Data1=wall, Data2=wall_2)  # -> flatten(Result)
debrep = DeconstructBrep(Brep=slab)  # -> Faces, Edges, Vertices
debrep_2 = DeconstructBrep(Brep=beam)  # -> Faces, Edges, Vertices
debrep_3 = DeconstructBrep(Brep=column)  # -> Faces, Edges, Vertices
debrep_4 = DeconstructBrep(Brep=wall_3)  # -> Faces, Edges, Vertices
len = Length(Curve=debrep.Edges)
len_2 = Length(Curve=debrep_2.Edges)
len_3 = Length(Curve=debrep_3.Edges)
item = ListItem(List=len, Index=[0, 1, 8], Wrap=True)
len_4 = Length(Curve=debrep_4.Edges)
item_2 = ListItem(List=len_3, Index=[0, 1, 8], Wrap=True)
item_3 = ListItem(List=len_2, Index=[0, 1, 8], Wrap=True)
item_4 = ListItem(List=len_4, Index=[0, 1, 8], Wrap=True)
ins = InsertItems(List=item, Item="slab", Indices=Slider(3, range=0..10), Wrap=True)
ins_2 = InsertItems(List=item_3, Item="beam", Indices=Slider(3, range=0..10), Wrap=True)
ins_3 = InsertItems(List=item_2, Item="column", Indices=Slider(3, range=0..10), Wrap=True)
ins_4 = InsertItems(List=item_4, Item="wall", Indices=Slider(3, range=0..10), Wrap=True)
L = ClusterOutput(ins)
L_2 = ClusterOutput(ins_2)
L_3 = ClusterOutput(ins_3)
L_4 = ClusterOutput(ins_4)

# ==== cluster TestSet
brep = Brep([<brep referenced from the Rhino model> x913])
brep_2 = Brep([<brep referenced from the Rhino model> x1685])
brep_3 = Brep([<brep referenced from the Rhino model> x330])
brep_4 = Brep([<brep referenced from the Rhino model> x83])
brep_5 = ClusterOutput(brep)
brep_6 = ClusterOutput(brep_2)
brep_7 = ClusterOutput(brep_3)
brep_8 = ClusterOutput(brep_4)
bbox = BoundingBox(Content=brep_2, Plane=PlaneXY(0, 0, 0))  # -> Box, Box_2
bbox_2 = BoundingBox(Content=brep_4, Plane=PlaneXY(0, 0, 0))  # -> Box, Box_2
bbox_3 = BoundingBox(Content=brep, Plane=PlaneXY(0, 0, 0))  # -> Box, Box_2
bbox_4 = BoundingBox(Content=brep_3, Plane=PlaneXY(0, 0, 0))  # -> Box, Box_2
debox = DeconstructBox(Box=bbox.Box)  # -> Plane, X, Y, Z
debox_2 = DeconstructBox(Box=bbox_2.Box)  # -> Plane, X, Y, Z
debox_3 = DeconstructBox(Box=bbox_3.Box)  # -> Plane, X, Y, Z
debox_4 = DeconstructBox(Box=bbox_4.Box)  # -> Plane, X, Y, Z
dedomain = DeconstructDomain(Domain=debox.X)  # -> Start, End
dedomain_2 = DeconstructDomain(Domain=debox_2.X)  # -> Start, End
dedomain_3 = DeconstructDomain(Domain=debox_3.X)  # -> Start, End
dedomain_4 = DeconstructDomain(Domain=debox.Z)  # -> Start, End
dedomain_5 = DeconstructDomain(Domain=debox_2.Z)  # -> Start, End
dedomain_6 = DeconstructDomain(Domain=debox.Y)  # -> Start, End
dedomain_7 = DeconstructDomain(Domain=debox_2.Y)  # -> Start, End
dedomain_8 = DeconstructDomain(Domain=debox_3.Z)  # -> Start, End
dedomain_9 = DeconstructDomain(Domain=debox_3.Y)  # -> Start, End
dedomain_10 = DeconstructDomain(Domain=debox_4.X)  # -> Start, End
dedomain_11 = DeconstructDomain(Domain=debox_4.Z)  # -> Start, End
dedomain_12 = DeconstructDomain(Domain=debox_4.Y)  # -> Start, End
subtraction = Subtraction(A=dedomain_4.End, B=dedomain_4.Start)  # -> simplify(graft(Result))
subtraction_2 = Subtraction(A=dedomain_5.End, B=dedomain_5.Start)  # -> simplify(graft(Result))
subtraction_3 = Subtraction(A=dedomain_6.End, B=dedomain_6.Start)  # -> simplify(graft(Result))
subtraction_4 = Subtraction(A=dedomain_7.End, B=dedomain_7.Start)  # -> simplify(graft(Result))
subtraction_5 = Subtraction(A=dedomain.End, B=dedomain.Start)  # -> simplify(graft(Result))
subtraction_6 = Subtraction(A=dedomain_2.End, B=dedomain_2.Start)  # -> simplify(graft(Result))
subtraction_7 = Subtraction(A=dedomain_8.End, B=dedomain_8.Start)  # -> simplify(graft(Result))
subtraction_8 = Subtraction(A=dedomain_9.End, B=dedomain_9.Start)  # -> simplify(graft(Result))
subtraction_9 = Subtraction(A=dedomain_3.End, B=dedomain_3.Start)  # -> simplify(graft(Result))
subtraction_10 = Subtraction(A=dedomain_11.End, B=dedomain_11.Start)  # -> simplify(graft(Result))
subtraction_11 = Subtraction(A=dedomain_12.End, B=dedomain_12.Start)  # -> simplify(graft(Result))
subtraction_12 = Subtraction(A=dedomain_10.End, B=dedomain_10.Start)  # -> simplify(graft(Result))
merge = Merge(Data1=subtraction_5, Data2=subtraction_3, Data3=subtraction)
merge_2 = Merge(Data1=subtraction_6, Data2=subtraction_4, Data3=subtraction_2)
merge_3 = Merge(Data1=subtraction_9, Data2=subtraction_8, Data3=subtraction_7)
merge_4 = Merge(Data1=subtraction_12, Data2=subtraction_11, Data3=subtraction_10)
ins = InsertItems(List=merge_3, Item=graft("column"), Indices=3, Wrap=True)  # -> simplify(List)
ins_2 = InsertItems(List=merge_2, Item=graft("slab"), Indices=3, Wrap=True)  # -> simplify(List)
ins_3 = InsertItems(List=merge, Item=graft("beam"), Indices=3, Wrap=True)  # -> simplify(List)
ins_4 = InsertItems(List=merge_4, Item=graft("wall"), Indices=3, Wrap=True)  # -> simplify(List)
flip = FlipMatrix(Data=ins)
flip_2 = FlipMatrix(Data=ins_3)
flip_3 = FlipMatrix(Data=ins_4)
flip_4 = FlipMatrix(Data=ins_2)
merge_5 = Merge(Data1=flip, Data2=flip_2, Data3=flip_3, Data4=flip_4)  # -> flatten(Result)
R = ClusterOutput(merge_5)
